# Grasshopper definition 240812_chairModifyTest.gh (Grasshopper 1.0.8)
# plug-ins: RhinoCodePluginGH, Pufferfish, Human, eleFront, OrigamiCraneV8

merge = Merge(Data1=Slider(46, range=0..100), Data2=Slider(2, range=0..100), Data3=Slider(40, range=0..100))

# ----
# 還不能調整 未寫入程式
gene_pool = GenePool(Decimals=0, Maximum=20, Minimum=5, Value=[5, 5, 12.5, 12.5, 12.5, 12.5])
gene_pool_2 = GenePool(Decimals=0, Maximum=2, Minimum=0, Value=[1.115382073, 1, 0, 0, 0, 0])
gene_pool_3 = GenePool(Decimals=0, Maximum=12, Minimum=0, Value=[9.031311855, 1.598574793, 8, 9, 10, 11])
entwine = Entwine(Branch00=gene_pool_3, Branch01=gene_pool, Branch02=gene_pool_2, FlattenInputs=True)  # -> simplify(Result)
flip_matrix = FlipMatrix(Data=entwine)

# ----
# 還不能調整 未寫入程式
gene_pool_4 = GenePool(Decimals=0, Maximum=50, Minimum=0, Value=[0, 0, 0])
merge_2 = Merge(Data1=gene_pool_4)

gene_pool_5 = GenePool(Decimals=0, Maximum=50, Minimum=-50, Value=[50, 9, -3])
gene_pool_6 = GenePool(Decimals=0, Maximum=50, Minimum=-50, Value=[3, 4, 6])
entwine_2 = Entwine(Branch00="2", Branch01=gene_pool_5, Branch02=gene_pool_6, FlattenInputs=True)  # -> simplify(Result)

# ----
# 假設此json資料從Deep learning 得到
# OrigamiCrane\jsonFormat\chair.json
panel = Panel("""[{
    "name": "Chair_Sit",
    "localPlane": {
      "originX": 259.0,
      "originY": 621.0,
      "originZ": 100.0,
      "normalX": -0.0,
      "normalY": 0.0,
      "normalZ": 1.0
    },
    "curveParameters": {
      "thicknessType": "Offset",
      "thickness": 50,
      "curve1PointSet": [
        [59,871,100],[59,705,100],[59,538,100],[59,371,100]
      ],
      "curve2PointSet": [
        [459,871,100],[326,871,100],[193,871,100],[59,871,100]
      ]
    },
    "rotateParameters": {
      "rotateDegrees": {
        "rx": 0,
        "ry": 0,
        "rz": 0
      },
      "useLocalPlane": false
    },
    "filletParameters": [
      {
        "filletType": 0,
        "edgeIndex": [
          0,
          2,
          7,
          9
        ],
        "edgeRadii": [
          20,
          30,
          25,
          30
        ]
      },
      {
        "filletType": 1,
        "edgeIndex": [],
        "edgeRadii": []
      },
      {
        "filletType": 2,
        "edgeIndex": [
          5,
          8,
          3,
          1
        ],
        "edgeRadii": [
          10,
          15,
          10,
          15
        ]
      }
    ]
  },{
    "name": "Chair_leg_FL",
    "localPlane": {
      "originX": 105.0,
      "originY": 397.0,
      "originZ": -103.0,
      "normalX": -1.0,
      "normalY": 0.0,
      "normalZ": 0.0
    },
    "curveParameters": {
      "thicknessType": "Offset",
      "thickness": 50,
      "curve1PointSet": [
        [105,385,-207],[105,393,-207],[105,401,-207],[105,409,-207]
      ],
      "curve2PointSet": [
        [105,409,-207],[105,409,-138],[105,409,-69],[105,409,0]
      ]
    },
    "rotateParameters": {
      "rotateDegrees": {
        "rx": 0,
        "ry": 0,
        "rz": 0
      },
      "useLocalPlane": false
    },
    "filletParameters": [
      {
        "filletType": 0,
        "edgeIndex": [
          0,
          2,
          7,
          9
        ],
        "edgeRadii": [
          20,
          30,
          25,
          30
        ]
      },
      {
        "filletType": 1,
        "edgeIndex": [],
        "edgeRadii": []
      },
      {
        "filletType": 2,
        "edgeIndex": [
          5,
          8,
          3,
          1
        ],
        "edgeRadii": [
          10,
          15,
          10,
          15
        ]
      }
    ]
  },{
    "name": "Chair_leg_FR",
    "localPlane": {
      "originX": 414.0,
      "originY": 397.0,
      "originZ": -103.0,
      "normalX": -1.0,
      "normalY": 0.0,
      "normalZ": 0.0
    },
    "curveParameters": {
      "thicknessType": "Offset",
      "thickness": 50,
      "curve1PointSet": [
        [414,409,-207],[414,401,-207],[414,393,-207],[414,385,-207]
      ],
      "curve2PointSet": [
        [414,409,0],[414,409,-69],[414,409,-138],[414,409,-207]
      ]
    },
    "rotateParameters": {
      "rotateDegrees": {
        "rx": 0,
        "ry": 0,
        "rz": 0
      },
      "useLocalPlane": false
    },
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""")
data = Data(panel)
partname = ValueList({"Chair_Sit", "Chair_leg_FL", "Chair_leg_FR", "Chair_leg_BR", "Chair_leg_BL", "Chair_back", "Chair_hand_L", "Chair_hand_R"}, selected="Chair_Sit")
buildmodifyfurniture = BuildModifyFurniture(FurnitureJSON=data, ModifyPartName=partname, CurvesModify=entwine_2, RotateModify=merge_2, FilletModify=flip_matrix)  # -> GeoBefore, GeoAfter, C
curve = Curve(<curve referenced from the Rhino model>)
curve_2 = Curve(<curve referenced from the Rhino model>)
deconstruct_brep = DeconstructBrep(Brep=buildmodifyfurniture.GeoBefore)  # -> Faces, Edges, Vertices
sum_surface = SumSurface(CurveA=curve, CurveB=curve_2)
divide_curve = DivideCurve(Curve=curve, Count=Slider(2, range=0..10), Kinks=False)  # -> Points, Tangents, Parameters
list_length = ListLength(List=divide_curve.Points)
custom_preview = CustomPreview(Geometry=deconstruct_brep.Edges, Material=ColourSwatch(SwatchColor=RGB(0, 0, 0)))
custom_preview_2 = CustomPreview(Geometry=buildmodifyfurniture.GeoAfter, Material=ColourSwatch(SwatchColor=RGBA(153, 255, 207, 144)))
offset_surface = OffsetSurface(Surface=sum_surface, Distance=Slider(50, range=0..100), BothSides=0, CreateSolid=True)
cloud_display = CloudDisplay(
    Points=divide_curve.Points,
    Colours=ColourSwatch(SwatchColor=RGB(255, 255, 255)),
    Size=Slider(9, range=0..10),
    SpriteType=0)
series = Series(Start=0, Step=1, Count=list_length)
define_text_dot = DefineTextDot(Text=series, Location=divide_curve.Points, Font="Arial", Size=14)
sit = ValueList({"One": 1, "Two": 2, "Three": 2² - 1, "Four": Sqrt(16)}, selected="One")
c_script = CSharpScript(x=buildmodifyfurniture.GeoBefore, name=sit)  # -> out, a
# ---------- c_script: C# ----------
// Grasshopper Script Instance
#region Usings
using System;
using System.Linq;
using System.Collections;
using System.Collections.Generic;
using System.Drawing;

using Rhino;
using Rhino.Geometry;

using Grasshopper;
using Grasshopper.Kernel;
using Grasshopper.Kernel.Data;
using Grasshopper.Kernel.Types;
#endregion

public class Script_Instance : GH_ScriptInstance
{
    #region Notes
    /* 
      Members:
        RhinoDoc RhinoDocument
        GH_Document GrasshopperDocument
        IGH_Component Component
        int Iteration

      Methods (Virtual & overridable):
        Print(string text)
        Print(string format, params object[] args)
        Reflect(object obj)
        Reflect(object obj, string method_name)
    */
    #endregion

    private void RunScript(object x, object name, ref object a)
    {
        // Write your logic here
        a = null;
    }
}
# ---------- end c_script ----------
panel_2 = Panel(entwine_2)
tree_branch = TreeBranch(Tree=panel_2, Path="{2}", MaintainPaths=True)
tree_branch_2 = TreeBranch(Tree=panel_2, Path="{1}", MaintainPaths=True)

brep = Brep(buildmodifyfurniture.GeoBefore)
list_item = ListItem(List=brep, Index=0, Wrap=True)
deconstruct_brep_2 = DeconstructBrep(Brep=list_item)  # -> Faces, Edges, Vertices
list_item_2 = ListItem(List=deconstruct_brep_2.Faces, Index=0, Wrap=True)
iso_curve = IsoCurve(Surface=reparameterize(list_item_2), UVPoint="0.5,0.5")  # -> UIsocurve, VIsocurve
merge_3 = Merge(Data1=Slider(0, range=0..100), Data2=Slider(2, range=0..100), Data3=Slider(62, range=0..100))
list_length_2 = ListLength(List=merge_3)
custom_preview_lineweights = CustomPreviewLineweights(
    Geometry=iso_curve.UIsocurve,
    Shader=ColourSwatch(SwatchColor=RGB(8, 255, 0)),
    Thickness=Slider(5, range=0..10),
    Absolute=False)
custom_preview_lineweights_2 = CustomPreviewLineweights(
    Geometry=iso_curve.VIsocurve,
    Shader=ColourSwatch(SwatchColor=RGB(207, 215, 255)),
    Thickness=Slider(5, range=0..10),
    Absolute=False)
curve_3 = Curve(iso_curve.VIsocurve)
subtraction = Subtraction(A=list_length_2, B=1)
divide_curve_2 = DivideCurve(Curve=curve_3, Count=subtraction, Kinks=False)  # -> Points, Tangents, Parameters
unit_z = UnitZ(Factor=merge_3)
move = Move(Geometry=divide_curve_2.Points, Motion=unit_z)  # -> Geometry, Transform
interpolate = Interpolate(Vertices=move.Geometry, Degree=3, Periodic=False, KnotStyle=1)  # -> Curve, Length, Domain
dot_display = DotDisplay(Point=move.Geometry, Colour=ColourSwatch(SwatchColor=RGB(255, 255, 255)), Size=Slider(5, range=0..10))
custom_preview_lineweights_3 = CustomPreviewLineweights(
    Geometry=interpolate.Curve,
    Shader=ColourSwatch(SwatchColor=RGB(0, 42, 255)),
    Thickness=Slider(5, range=0..10),
    Absolute=False)

panel_3 = Panel(tree_branch_2)
panel_4 = Panel(tree_branch)

# ----
# Select(n => n.Value)
list_item_3 = ListItem(List=panel_4, Index=0, Wrap=True)  # -> Item, Item1, Item2
number = Number(list_item_3.Item)
number_2 = Number(list_item_3.Item1)
number_3 = Number(list_item_3.Item2)

# ----
# Select(n => n.Value)
list_item_4 = ListItem(List=panel_3, Index=0, Wrap=True)  # -> Item, Item1, Item2
number_4 = Number(list_item_4.Item)
number_5 = Number(list_item_4.Item1)
number_6 = Number(list_item_4.Item2)

# ----
# .ToList()
merge_4 = Merge(Data1=number, Data2=number_2, Data3=number_3)
number_7 = Number(merge_4)
panel_5 = Panel(number_7)

# ----
# .ToList()
merge_5 = Merge(Data1=number_4, Data2=number_5, Data3=number_6)
number_8 = Number(merge_5)
panel_6 = Panel(number_8)

sweep2 = Sweep2(SameHeight=False)
sweep1 = Sweep1(Miter=1)
