# Grasshopper definition 240906_chairModifyTest.gh (Grasshopper 1.0.8)
# plug-ins: OrigamiCraneV8

# ----
# 還要debug
fillettype = GenePool(Decimals=0, Maximum=2, Minimum=0, Value=[1, 1, 0, 0, 0, 0])
edgeindex = GenePool(Decimals=0, Maximum=12, Minimum=0, Value=[9.031311855, 1.598574793, 8, 9, 10, 11])
edgeradii = GenePool(Decimals=0, Maximum=20, Minimum=5, Value=[5, 5, 12.5, 12.5, 12.5, 12.5])
entwine = Entwine(Branch00=edgeindex, Branch01=edgeradii, Branch02=fillettype, FlattenInputs=True)  # -> simplify(Result)
flip_matrix = FlipMatrix(Data=entwine)

gene_pool = GenePool(Decimals=0, Maximum=50, Minimum=-50, Value=[29, 9, -3])
gene_pool_2 = GenePool(Decimals=0, Maximum=50, Minimum=-50, Value=[3, 4, 6])
entwine_2 = Entwine(Branch00=gene_pool, Branch01=gene_pool_2, FlattenInputs=True)  # -> simplify(Result)

panel = Panel("""10
0
0""")
number = Number(panel)

partname = ValueList({"Chair_Sit", "Chair_leg_FL", "Chair_leg_FR", "Chair_leg_BR", "Chair_leg_BL", "Chair_back", "Chair_hand_L", "Chair_hand_R"}, selected="Chair_Sit")
# 假設此json資料從Deep learning 得到
# OrigamiCraneV8\jsonFormat\chair.json
panel_2 = Panel("""[
    {
        "name": "Chair_Sit",
        "localPlane": {
            "originX": 259.0, "originY": 621.0, "originZ": 100.0,
            "normalX": -0.0, "normalY": 0.0, "normalZ": 1.0
        },
        "curveParameters": {
            "thicknessType": "Offset", "thickness": 50,
            "curve1PointSet": [[59, 871, 100], [59, 705, 100], [59, 538, 100], [59, 371, 100]],
            "curve2PointSet": [[459, 871, 100], [326, 871, 100], [193, 871, 100], [59, 871, 100]]
        },
        "rotateParameters": {
            "rotateDegrees": {"rx": 0, "ry": 0, "rz": 0},
            "useLocalPlane": false
        },
        "filletParameters": {
            "ChamferFillet": {"edgeIndex": [0, 2, 7, 9], "edgeRadii": [20, 30, 25, 30]},

            "FilletFillet": {"edgeIndex": [], "edgeRadii": []},

            "BlendFillet": {"edgeIndex": [5, 8, 3, 1], "edgeRadii": [10, 15, 10, 15]}
        }
    },
    {
        "name": "Chair_leg_FL",
        "localPlane": {
            "originX": 105.0, "originY": 397.0, "originZ": -103.0,
            "normalX": -1.0, "normalY": 0.0, "normalZ": 0.0
        },
        "curveParameters": {
            "thicknessType": "Offset", "thickness": 50,
            "curve1PointSet": [[105, 385, -207], [105, 393, -207], [105, 401, -207], [105, 409, -207]],
            "curve2PointSet": [[105, 409, -207], [105, 409, -138], [105, 409, -69], [105, 409, 0]]
        },
        "rotateParameters": {
            "rotateDegrees": {"rx": 0, "ry": 0, "rz": 0},
            "useLocalPlane": false
        },
        "filletParameters": {
            "ChamferFillet": {"edgeIndex": [0, 2, 7, 9], "edgeRadii": [20, 30, 25, 30]},
            "FilletFillet": { "edgeIndex": [], "edgeRadii": []},
            "BlendFillet": {"edgeIndex": [5, 8, 3, 1], "edgeRadii": [10, 15, 10, 15]}
        }
    },
    {
        "name": "Chair_leg_FR",
        "localPlane": {
            "originX": 414.0, "originY": 397.0, "originZ": -103.0,
            "normalX": -1.0, "normalY": 0.0, "normalZ": 0.0
        },
        "curveParameters": {
            "thicknessType": "Offset", "thickness": 50,
            "curve1PointSet": [[414, 409, -207], [414, 401, -207], [414, 393, -207], [414, 385, -207]],
            "curve2PointSet": [[414, 409, 0], [414, 409, -69], [414, 409, -138], [414, 409, -207]]
        },
        "rotateParameters": {
            "rotateDegrees": {"rx": 0, "ry": 0, "rz": 0},
            "useLocalPlane": false
        },
        "filletParameters": {
            "ChamferFillet": {"edgeIndex": [0, 2, 7, 9], "edgeRadii": [20, 30, 25, 30]},
            "FilletFillet": { "edgeIndex": [], "edgeRadii": []},
            "BlendFillet": { "edgeIndex": [5, 8, 3, 1], "edgeRadii": [10, 15, 10, 15]}
        }
    },
    {
        "name": "Chair_leg_BR",
        "localPlane": {
            "originX": 414.0, "originY": 808.0, "originZ": -103.0,
            "normalX": 1.0, "normalY": 0.0, "normalZ": 0.0
        },
        "curveParameters": {
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""")
data = Data(panel_2)
buildmodifyfurniture = BuildModifyFurniture(FurnitureJSON=data, ModifyPartName=partname, CurvesModify=entwine_2, RotateModify=number, FilletModify=flip_matrix)  # -> GeoBefore, GeoAfter, Json, Log
panel_3 = Panel(buildmodifyfurniture.Log)
deconstruct_brep = DeconstructBrep(Brep=buildmodifyfurniture.GeoBefore)  # -> Faces, Edges, Vertices
custom_preview = CustomPreview(Geometry=deconstruct_brep.Edges, Material=ColourSwatch(SwatchColor=RGB(0, 0, 0)))
custom_preview_2 = CustomPreview(Geometry=buildmodifyfurniture.GeoAfter, Material=ColourSwatch(SwatchColor=RGBA(153, 255, 207, 144)))
